# Grasshopper definition GetStreamWithToken.gh (Grasshopper 1.0.7)
# plug-ins: Speckle 2

list = Accounts(
    {"No account selected": , "Account (ryan@stykka.com | https://geo.stykka.com)": "d00fa513a9", "Account (ryan@stykka.com | https://dev.stykka.com)": "6bbf712c25"}, selected="Account (ryan@stykka.com | https://dev.stykka.com)",
    selectedId="6bbf712c25",
    selectedServer="https://dev.stykka.com")
userid = GetString(list, AtLeast=1, AtMost=1, TreeAccess=False)
sgat = GetAccountToken(Account=userid)
sgetwt = StreamGetWithToken(Stream="https://dev.stykka.com/streams/aa6b496028", AuthToken=sgat)
panel = Panel(sgat)
sr = SynchronousReceiver(
    Stream=sgetwt,
    AutoReceive=True,
    KitName="Objects",
    ReceivedObjectId="f5b753756af3476db6a6590c1264b65d",
    StreamWrapper="https://dev.stykka.com/streams/aa6b496028?u=6bbf712c25",
    selectedKitName="Objects")  # -> Data, Info
