# Grasshopper definition GetStreamWithToken_WithLCACalc_v2.0.gh (Grasshopper 1.0.7)
# plug-ins: Speckle 2

list = Accounts(
    {"No account selected": , "Account (alexander.m.jacobson@gmail.com | https://dev.stykka.com)": "b31d9ab7d4"}, selected="Account (alexander.m.jacobson@gmail.com | https://dev.stykka.com)",
    selectedId="b31d9ab7d4",
    selectedServer="https://dev.stykka.com")
sgat = GetAccountToken(Account=list)
sgetwt = StreamGetWithToken(Stream="https://dev.stykka.com/streams/aa6b496028", AuthToken=sgat)
panel = Panel(sgat)
sr = SynchronousReceiver(
    Stream=sgetwt,
    AutoReceive=True,
    KitName="Objects",
    ReceivedObjectId="4baa0842fde9c31828d720b293df0674",
    StreamWrapper="https://dev.stykka.com/streams/aa6b496028?u=b31d9ab7d4",
    selectedKitName="Objects")  # -> Data, Info
constructionsystemnames = Panel("""Drain, Single-Family house (Default value)
Drain, Multifamily residence (Default value)
Drain, Office, School and Day care (Default value)
Drain, Terrace house (Default value)
Drain, Other buildings (Default value)
Balcony access, concrete
Balcony access, steel
Cladding, fire plasterboard 15 mm
Cladding, fire plasterboard 20 mm
Cladding, fire plasterboard 25 mm
Cladding, fire plasterboard 30 mm
Paving, asphalt 
Paving, asphalt against ground floor
Paving, concrete slabs, 5 cm 
Paving, concrete slabs, 8 cm 
Balcony platform, aluminum bottom with wooden floor 
Balcony platform, concrete bottom, reinforced
Balcony platform, steel frame with floor of aluminum plate
Balcony platform, steel frame with fibre concrete floor
Balcony platform, steel frame with wooden floor
Floor deck, concrete bottom plate
Floor deck, concrete element, prestressed hollow deck 0.18/7.0 m
Floor deck, concrete element, prestressed hollow deck 0.22/12.0 m
Floor deck, concrete element, prestressed hollow deck 0.22/7.0 m
Floor deck, concrete element, prestressed hollow deck 0.27/12.0 m
Floor deck, concrete element, prestressed hollow deck 0.27/7.0 m
Floor deck, concrete element, prestressed hollow deck 0.32/12.0 m
Floor deck, concrete element, lightweight concrete 0.16/0.5 m
Slab, concrete element, lightweight concrete 0.18
Floor deck, concrete element, lightweight concrete 0.2/7.0 m
Floor deck, concrete element, lightweight concrete 0.24/7.0 m
Slab, floor beam 50/195 mm per 60 cm, insulation
Deck, solid timber/concrete element 0.28/7.0, floor deck
Floor deck, in-situ cast 0.2/5.0 m
Floor deck, in-situ cast 0.3/7.0 m
Floor deck, steel floor deck
Floor deck, timber, CLT element 0.2/5.0 m
Floor deck, timber element 0.38/6.0 m
Door, fire door T30
Door, fire door T90
Door, front door
Door, industrial- and garage gate, alu
Door, industrial- and garage gate, steel
Door, revolving door
Door, roller door, alu
Door, roller grille, steel
Door, smoke door
Post-insulation of sloping roof in accessible roof space, cellulose
Post-insulation of sloping roof from inside, mineral wool
Post-insulation of sloping roof from inside, cellulose fibre
Post-insulation of sloping roof from outside, mineral wool
Post-insulation of sloping roof from outside, cellulose
Ex. Back stairs, basement, concrete
Ex. Back stairs, basement, bricked
Ex. Timber frame wall 170 mm (3/4 brick)
Ex. Timber frame wall 225 mm (1 brick)
Ex. Timber frame wall 110 mm (1/2 brick)
Ex. Timber board partition wall 52 mm
Ex. EB1 Back stairs, normal floor
Ex. EB1 Back stairs, ground floor
Ex. EB1 Main staircase, normal floor
Ex. EB1 Main staircase, ground floor
Ex. AB1 Copenhagen roof, slate
Ex. AB1 Copenhagen roof, tile
Ex. Copenhagen roof, zinc
Ex. AB1 Mansard roof, slate
Ex. AB1 Mansard roof, tile
Ex. AB1 Mansard roof, zinc
Ex. AB1 Sloped roof, slate
Ex. AB1 sloped roof, tile
Ex. AB1 Slopoed roof, zinc
Ex. Interior door, wood
Ex. steel hybrid floor
Ex. Masonry 110 mm (1/2 brick)
Ex. Masonry 170 mm (3/4 brick)
Ex. Masonry 230 mm (1 brick)
Ex. Masonry 240 mm (1 1/2 bricks)
Ex. Masonry 460 mm (2 bricks)
Ex. Masonry 580 mm (2 1/2 bricks)
Ex. Masonry 700 mm (3 bricks)
Ex. Masonry 810 mm (3 1/2 bricks)
Ex. Masonry 930 mm (4 bricks)
Ex. Ground floor deck, non-reinforced concrete 100 mm
Ex. Timber floor frame
Ex. Exterior door, wood
Ex. Window, wood
Flat roof, wood truss (H=620 mm) per 815 mm, 525 mm cellulosefibre insulation
Flat roof, wood truss (H=600 mm) per 1000 mm, 500 mm cellulosefibre insulation
Flat roof, wood truss (H=600 mm) per 1000 mm, uninsulated
Flat roof window, plastic (complete window)
Glass roof, aluminum (complete window)
Flooring, concrete wear layer
Flooring, ceramic tiles
Flooring, carpet
Flooring, rubber
Flooring, laminate
Flooring, linoleum
Flooring, natural stone tiles
Flooring, parquet on EPS-concrete
Floor, parquet, glued
Flooring, parquet, floating
Flooring, timber flooring on joists
Flooring, vinyl
Flooring, wet room floor, ceramic tiles
Flooring, wet room floor, non-slip vinyl
Floor heating pipes, PEX, 100 mm disance
Floor heating pipes, PEX, 200 mm disance
Underfloor heating system PEX (250mm distance)
Underfloor heating system PEX (300mm distance)
Interior wall surface, interior post-insulation, front wall, mineral wool
Interior wall surface, interior post-insulation, aerated concrete blocks
Internal glass wall
Internal glass wall (EI30)
Frame, curtain wall facade, aluminum
Frame, curtain wall facade, steel
Frame, windows, aluminum
Frame, windows, plastic
Frame, windows, timber
Frame, windows, timber/aluminum
Ceiling, acrylic paint
Ceiling, fire plaster for e.g. light apartment partition
Ceiling, fibre cement boards, directly
Ceiling, gypsum based acoustic panels on wood framework
Ceiling, platerboard on steel profiles
Ceiling, gypsum plasterboard on wooden battens 
Ceiling, insulated, ceiling over open air
Ceiling, towards unheated room
Ceiling, suspended demountable  system-ceiling
Ceiling, perforated plywood
Ceiling, perforated steel, suspended
Ceiling, timber, board ceiling
Ceiling, wood wool cement bonded, suspended
Ceiling, cement bonded wood wool on wooden framework
Ceiling, timber slats
Middle layer, concrete element 120 mm
Middle layer, concrete element 120 mm, EPS insulation
Middle layer, concrete element 120 mm, mineral wool
Middle layer, concrete element 150 mm
Middle layer, concrete element 150 mm, EPS insulation
Middle layer, concrete element 150 mm, mineral wool
Middle layer, concrete element 180 mm
Middle layer, concrete element 180 mm, EPS insulation
Middle layer, concrete element 180 mm, mineral wool
Middle layer, concrete element 200 mm
Middle layer, concrete element 200 mm, EPS insulation
Middle layer, concrete element 200 mm, mineral wool
Middle layer, concrete element, lightweight concrete 100 mm
Middle layer, concrete element, lightweight concrete 100 mm, EPS insulation
Middle layer, concrete element, lightweight concrete 100 mm, mineral wool
Middle layer, concrete element, lightweight concrete 120 mm
Middle layer, concrete element, lightweight concrete 120 mm, EPS insulation
Middle layer, concrete element, lightweight concrete 120 mm, mineral wool
Middle layer, concrete element, lightweight concrete 150 mm
Middle layer, concrete element, lightweight concrete 150 mm, EPS insulation
Middle layer, concrete element, lightweight concrete 150 mm, mineral wool
Middle layer, clay bricks unfired, non-bearing 
Middle layer, aerated concrete, 100 mm
Middle construction, aerated concrete, 125 mm
Middle construction, aerated concrete, 150 mm
Middle layer, aerated concrete, 200 mm
Middle layer, steel-sandwich-panel, 200 mm
Middle layer, steel skeleton, mineral wool
Middle layer, steel frame, mineral wool
Middle layer, brick blocks, load-bearing
Middle layer, bricks, load-bearing
Middle layer, wood, CLT element 100 mm, mineral wool
Middle layer, wood, CLT elememt 150 mm, mineral wool
Middle layer, timber, CLT elememt 200 mm, mineral wool
Middle layer, timber, CLT element, load-bearing 100 mm
Middle layer, timber, CLT element, load-bearing 150 mm
Middle layer, timber, CLT element, load-bearing 200 mm
Middle layer, timber, CLT element, non-bearing
Middle layer, timber element in 2 parts, apartment separation
Middle layer, timber element, apartment separation
Middle layer, wood construction, mineral wool
Middle layer, wood construction, cellulose fibre insulation
Middle layer, timber skeleton, load-bearing, mineral wool
Middle layer, timber skeleton, load-bearing, wood fibers
Middle layer, timber skeleton, non-bearing, mineral wool
Middle layer, timber skeleton, non-bearing, wood fibre
Middle layer, wood frame wall 45/195 mm, unisolated
Middle layer, wood frame wall 45/195 mm, 200 mm mineral wool
Middle layer, wood frame wall 45/195 mm, 300 mm mineral wool
Middle layer, wood frame wall 45/245 mm, 245 mm cellulose fibre insulation
Middle layer, wood frame wall 45/95 mm, with OSB
Middle construction, wooden frame 45/95 per 600 mm, non-load-bearing, mineral wool
Middle layer, concrete, lightweight clinker concrete, insulated
Middle layer, concrete, aerated concrete 100 mm, mineral wool
Middle layer, concrete, aereated concrete 100 mm, mineral wool 190 mm
Middle layer, concrete, aereated concrete 100 mm, mineral wool 190 mm and aereated concrete 100 mm
Middle layer, concrete, aereated concrete 125 mm, mineral wool 190 mm
Middle layer, concrete, aereated concrete 150 mm, mineral wool 190 mm
Middle layer, concrete, aereated concrete 200 mm, mineral wool 190 mm
Middle layer, concrete, aerated concrete, insulated
Middle layer, concrete element, lightweight concrete 0.16/5.0 m
Middle layer, concrete element, lightweight concrete 0.2/7.0 m
Middle layer, concrete element, lightweight 0.24/7.0 m
Middle layer, beam rafters, unventilated, sloping roofs, mineral wool
Middle layer, beam rafters, ventilated, sloping roofs, mineral wool
Middle layer, post-insulation, EPS for plaster/insulated cladding
Middle layer, post-insulation, PU for plaster/ventilated cladding
Middle layer, post-insulation, wooden front element
Middle layer, post-insulation, mineral wool for plaster/insulated cladding
Middle layer, prestressed hollow deck 0.18/7.0 m
Middle layer, prestressed hollow deck 0.32/12.0 m
Middle layer, lattice rafters, mineral wool and cellulose insulation
Middle layer, straw-based wall modules
Middle layer, in-situ cast 0.2/5.0 m, mineral wool
Middle layer, in-situ cast 0.3/7.0 m, mineral wool
Middle layer, steel-sandwich-panel 300 mm
Middle layer, steel deck
Middle layer, brick block, insulated
Middle layer, bricks, mineral wool
Middle layer, timber, CLT-element 0.2/5.0 m
Middle layer, timber element, unvenilated, flat roofs, 7.2 m
Middle layer, timber element, unventilated, flat roofs, 8 m
Middle layer, timber element, unventilated, sloping roofs, 8 m
Middle layer, timber element, ventilated, flat/sloping roofs, 8 m
Skylight dome window, plastic (complete skylight)
Radiator
Ren. Re-insulation of floor deck against cold space
Ren. Re-insulation between floor joists
Ren. Re-insulation of dormer (isolering, raised rafter)
Ren. Re-insulation of basement floor between joists
Ren. Re-insulation of loft (blown-in insulation, raised rafter)
Ren. Re-insulation of plinth
Ren. Re-insulation below elevated ground floor
Ren. Cavity wall insulation (blown-in)
Ren. Interior re-insulation of mansard attic
Ren. Interior re-insulation of dormer (insulation)
Ren. Interior re-insulation of sloped roof (insulation, raised rafter)
Ren. Interior re-insulation of facade (steel substructure)
Ren. Interior re-insulation of facade (with timber frame)
Ren. Replacement of double window frame
Ren. Replacement of extra internal frame
Ren. Exterior re-insulation of flat cold roof (insulation)
Ren. Exterior re-insulation of flat warm roof (insulation)
Ren. Exterior re-insulation of sloped roof (insulation)
Ren. Exterior re-insulation of sloped roof (insulation, raised rafter)
Ren. Exterior re-insulation of facade (rendered)
Ren. Exterior re-insulation with ventilated facade (steel substructure)
Ren. Exterior re-insulation with ventilated facade (timber I-joist substructure)
Ren. Exterior re-insulation with ventilated facade (timber substructure)
Ren. Exterior re-insulation of facade, EPS
Capping layer, concrete C25/30, 50 mm
Window pane, 2-layer energy pane
Window pane, 3-layer energy pane
Roof window with double slope, plastic/aluminum (complete window)
Saddle roof, prefab. truss 25Â°, 555 mm insulation
Saddle roof, prefab. truss 25Â°, 595 mm insulation
Saddle roof, prefab. truss 25Â°, without insulation
Saddle roof, prefab. scissor truss 25Â°/15Â°, 500 mm insulation
Saddle roof, prefab. scissor truss 25Â°/15Â°, 600 mm insulation
Saddle roof, prefab. scissor truss 25Â°/15Â°, 550 mm insulation
Saddle roof, wooden rafters on a tap 45Â°, 400 mm insulation
Sun shutters, aluminium slats
Sun shade, foil, polyethylenterephthalat (PET)
Sun shutters, rool shutter (PVC)
Photovoltaic system 1000 kWh/mÂ²*a (no electricity credits)
Solar cells
Roofing, EPDM
Roofing, zink, double seam
Roofing, concrete roofing tiles
Roofing, extensive green roof
Roofing, fibre cement
Roofing, slate
Roofing, straw
Roofing, steel, trapezoidal plates 
Roofing, roofing felt
Roofing, roof tiles
Roof covering/- finishing, aluminium
Roof covering/- finishing, zink
Dormer, flat roof, per m2 window
Dormer, piched roof, per m2 window
Ground slab, concrete, 100 mm
Ground floor slab, concrete, 120 mm
Ground slab, concrete, 120 mm, reinforcement mesh, 150x150
Ground floor slab, concrete, 150 mm
Ground floor slab, concrete, 200 mm
Ground floor slab, concrete, 250 mm
Ground floor slab, lightweight
Exterior door, wood
Substrate, 150 mm EPS insulation and compacted gravel
Substrate, insulation EPS 350 mm and singles
Substrate, 360 mm EPS insulation and compacted gravel
Substrate, 400 mm EPS insulation and compacted gravel
Substrate, insulation foam glass and stable gravel
Plumbing, water, Single-Family house (Default value)
Plumbing, water, Multifamily residence (Default value)
Plumbing, water, Office, School and Day care (Default value)
Plumbing, water, Terrace house (Default value)
Plumbing, water, Other buildings (Default value)
Plumbing, Heat, Ventilation and Cooling, Single-Family house (Default value)
Plumbing, Heat, Ventilation and Cooling, Multifamily residence (Default value)
Plumbing, Heat, Ventilation and Cooling, Office, School and Day care (Default value)
Plumbing, Heat, Ventilation and Cooling, Terrace house (Default value)
Plumbing, Heat, Ventilation and Cooling, Other buildings (Default value)
window,timber with 3-layer pane
Wall surface, board cladding
Wall surface, fire plasterboard 2 layers, acrylic paint
Wall surface, fire plasterboard 3 layers, acrylic paint
Wall surface, fire plasterboard, acrylic paint
Wall surface, plasterboard 2 layers, acrylic paint
Wall surface, plasterboard, acrylic paint
Wall surface, plywood / plasterboard
Wall surface, clay/hemp plate
Wall surface, painting, acrylic paint, full plastering
Wall surface, paint, acrylic paint, glass fibre fleece, filling
Wall surface, painting, alkyd paint, full plastering
Wall surface, painting, silicate paint, full plastering
Wall surface, plaster of lime, silicate paint
Wall surface, plaster of clay
Wall surface, wet room wall, light wall
Wall surface, wet room wall, heavy wall
Exterior wall surface, bricks, front wall
Exterior wall surface, aluminum panels, aluminum subconstruction
Exterior wall surface, concrete element, front plate for sandwich element
Exterior wall surface, wood cladding, larch wood
Exterior wall surface, wood cladding, coniferous timber
Exterior wall surface, cement fibre board, timber substructure 
Exterior wall surface, limestone sandstone, front wall
Exterior wall surface, basement wall, moisture protection
Exterior wall surface, natural stone, ventilated facade
Exterior wall surface, plastic/timber composite, timber subconstruction
Exterior wall surface, plaster, lime
Exterior wall surface, plaster, lime-/cement-based
Exterior wall surface, plaster, mineral thin plaster
Exterior wall surface, slate, aluminum subconstruction
Exterior wall surface, slate, timber subconstruction
Exterior wall surface, bricks, aluminum subconstuction
Exterior wall surface, bricks, wooden subconstruction
Exterior wall surface, zink, vertical angle seam
Exterior wall surface, zink sheets, aluminum subconstruction
window, timber/aluminum frame with 3-layer pane""")
gwpscores = Panel("""1
6
2
4.5
1.5
121.35332
51.28267
2.029614
2.706152
3.38269
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""")
panel_2 = Panel("""Drain, Office, School and Day care (Default value)
Floor deck, in-situ cast 0.2/5.0 m""")
lcabyg_construction_scores = Data(gwpscores)
lcabyg_english_construction_names = Data(constructionsystemnames)
geo = Geometry([<brep referenced from the Rhino model> x2])
nameoftagongeometry = Text(panel_2)
area = Area(Geometry=geo)  # -> Area, Centroid
receive = Receive(
    Stream="https://dev.stykka.com/streams/aa6b496028",
    AutoReceive=False,
    CurrentComponentState="expired",
    ExpandOutput=True,
    LastInfoMessage="Ryan Hughes @ 2023-03-04T13:56:07.282Z: Initial box. (id:04de77b57a)",
    ReceiveOnOpen=False,
    ReceivedCommitId="04de77b57a",
    StreamWrapper="https://dev.stykka.com/streams/aa6b496028",
    selectedKitName="Objects")  # -> Info, Default, StandardViews
python = GhPythonScript(Names=lcabyg_english_construction_names, Scores=lcabyg_construction_scores)  # -> out, LookupDict; inputs Names: list, Scores: list
# ---------- python: Python ----------
lookupDict = {}
for i, name in enumerate(Names):
    lookupDict[name] =Scores[i]

LookupDict = [lookupDict]
# ---------- end python ----------
lcacalculator = GhPythonScript(
    NameToLookUp=nameoftagongeometry,
    AreaForCalculation=area.Area,
    ListOfAllNames=lcabyg_english_construction_names,
    ListOfAllScores=lcabyg_construction_scores)  # -> out, GWPScores, TotalGWPScore; inputs NameToLookUp: list, AreaForCalculation: list, ListOfAllNames: list, ListOfAllScores: list
# ---------- lcacalculator: Python ----------
allInputsOk = True

if not AreaForCalculation:
    AreaForCalculation = None
    allInputsOk = False

if not NameToLookUp:
    allInputsOk = False

if len(ListOfAllNames) != len(ListOfAllScores):
    allInputsOk = False

for tag in NameToLookUp:
    # print tag in ListOfAllNames
    pass
    
_GWPScores = []
if allInputsOk:
    for i, tag in enumerate(NameToLookUp):
        area = AreaForCalculation[i]
        
        if tag in ListOfAllNames:
            indexOfGWP = ListOfAllNames.index(tag)
            GWPPerArea = ListOfAllScores[indexOfGWP]
            GWPScoreForSurface = indexOfGWP * GWPPerArea
            _GWPScores.append(GWPScoreForSurface)
            
GWPScores  = _GWPScores
TotalGWPScore  = sum(GWPScores)
# ---------- end lcacalculator ----------
panel_3 = Panel(lcacalculator.TotalGWPScore)
panel_4 = Panel(lcacalculator.GWPScores)
path = FilePath("C:\Users\Homosapien\Documents\GitHub\BIG-LCATool\TOOL_WriteJSONLatin1Encoding.py")
file = ReadFile(File=path, PerLineParse=False)

writejson1 = BooleanToggle(False)
materialcatalogue_buildupcatalogue_layer = Data(python.LookupDict)  # "MaterialCatalogue,BuildupCatalogue,LayerAssignmentSet, or LCAProjectDictionary"
file_name = Panel("LCAAreaBasedConstructionSystems")
pathtojsonfiles = FilePath("C:\Users\Homosapien\Documents\GitHub\aec-hackathon\JSON\")
writejson_timestamp = WriteDictionaryToJSON(
    Code=file,
    FolderToWriteJSON=pathtojsonfiles,
    JSONFileName=file_name,
    DictionaryIn=materialcatalogue_buildupcatalogue_layer,
    Run=writejson1)  # -> Out, OutputPath
openfile = GhPythonScript(Path=writejson_timestamp.OutputPath, Button=Button())  # inputs Button: Boolean
# ---------- openfile: Python ----------
import subprocess

#if Button == True:
#    print 'foo'
#    os.system(Path)

if Path and Button == True:
    subprocess.Popen([Path], shell=True)
# ---------- end openfile ----------
