# Grasshopper definition GetStreamWithToken_v1.0.gh (Grasshopper 1.0.7)
# plug-ins: Speckle 2

list = Accounts(
    {"No account selected": , "Account (alexander.m.jacobson@gmail.com | https://dev.stykka.com)": "b31d9ab7d4"}, selected="Account (alexander.m.jacobson@gmail.com | https://dev.stykka.com)",
    selectedId="b31d9ab7d4",
    selectedServer="https://dev.stykka.com")
sgat = GetAccountToken(Account=list)
sgetwt = StreamGetWithToken(Stream="https://dev.stykka.com/streams/aa6b496028", AuthToken=sgat)
panel = Panel(sgat)
sr = SynchronousReceiver(
    Stream=sgetwt,
    AutoReceive=True,
    KitName="Objects",
    ReceivedObjectId="f5b753756af3476db6a6590c1264b65d",
    StreamWrapper="https://dev.stykka.com/streams/aa6b496028?u=b31d9ab7d4",
    selectedKitName="Objects")  # -> Data, Info
geo = Geometry(sr.Data)
